vi "index.gviweb"   [LabVIEW NXG 5.0.0]
panel controls:
  "USERNAME": string
  "Button": bool
  "old pp": bool
  "new pp": bool
  "dvor": bool
  "PASSWORD": string
  "tpr": bool
  "Button_6": bool
  "Button_7": bool
  "Button_8": bool
  "ERASE ALL": bool
  "Button_2": bool
  "Button_5": bool
  "Button_9": bool
  "HOME": bool
  "HOME1": bool
  "HOME2": bool
  "HOME3": bool
  "HOME4": bool
  "ERASE ALL_2": bool
  "Button_3": bool
  "Button_4": bool
  "Button_10": bool
  "tpr_2": bool
  "Button_11": bool
  "Button_12": bool
  "Button_13": bool
  "Button_14": bool
  "BACK10": bool
  "BACK9": bool
  "BACK8": bool
  "BACK7": bool
  "tpr_3": bool
  "Button_15": bool
  "Button_16": bool
  "Button_17": bool
  "HOME4_2": bool
  "tpr_4": bool
  "Button_18": bool
  "Button_19": bool
  "Button_20": bool
  "HOME4_3": bool
panel indicators:
  "Tab": i32
  "STATUS": string
  "LED": bool
  "FACILITY NAME": string
  "TIME(TMZ)": string
  "AC VOLTMETER": string
  "DATE": timestamp
  "FREQUENCY METER": string
  "AC AMMETER": string
  "POWER FACTOR": string
  "DC VOLTMETER CC1": string
  "DC AMMETER CC1": string
  "WATTHOUR METER": string
  "DC VOLTMETER CC2": string
  "DC AMMETER CC2": string
  "SIGNATURE/INITIAL": string
  "MONTH": T1
  "YEAR": T2
  "FACILITY NAME_2": string
  "DATE_2": timestamp
  "FACILITY NAME_3": string
  "FACILITY NAME_4": string
  "FACILITY NAME_5": string
  "FACILITY NAME_6": string
  "FACILITY NAME_7": string
  "FACILITY NAME_8": string
  "FACILITY NAME_9": string
  "FACILITY NAME_10": string
  "FACILITY NAME_11": string
  "FACILITY NAME_12": string
  "FACILITY NAME_13": string
  "FACILITY NAME": string
  "FACILITY NAME_2": string
  "TIME (MTZ)": string
  "FACILITY NAME_4": string
  "FACILITY NAME_5": string
  "CHECK THE FAN BELT": string
  "FACILITY NAME_7": string
  "FACILITY NAME_8": string
  "Timestamp": timestamp
  "CHECK THE FAN BELT_2": string
  "CHECK THE FAN BELT_3": string
  "REMARKS": string
  "SIGNATURE/INITIAL_2": string
  "MONTH_2": T3
  "YEAR_2": T2
  "FACILITY NAME_14": string
  "Timestamp_2": timestamp
  "FACILITY NAME_15": string
  "FACILITY NAME_16": string
  "FACILITY NAME_17": string
  "FACILITY NAME_18": string
  "FACILITY NAME_19": string
  "FACILITY NAME_20": string
  "FACILITY NAME_21": string
  "FACILITY NAME_22": string
  "Enum": T4
  "Enum_7": T2
  "Enum_3": T3
  "Enum_4": T2
  "FACILITY NAME_23": string
  "TIME(TMZ)_2": string
  "AC VOLTMETER_2": string
  "DATE_3": timestamp
  "FREQUENCY METER_2": string
  "AC AMMETER _2": string
  "POWER FACTOR_2": string
  "DC VOLTMETER CC1_2": string
  "DC AMMETER CC1_2": string
  "WATTHOUR METER_2": string
  "DC VOLTMETER CC2_2": string
  "DC AMMETER CC2_2": string
  "SIGNATURE/INITIAL_3": string
  "MONTH_3": T1
  "YEAR_3": T2
  "FACILITY NAME_24": string
  "DATE_4": timestamp
  "FACILITY NAME_25": string
  "FACILITY NAME_26": string
  "FACILITY NAME_27": string
  "FACILITY NAME_28": string
  "FACILITY NAME_29": string
  "FACILITY NAME_30": string
  "FACILITY NAME_31": string
  "FACILITY NAME_32": string
  "FACILITY NAME_33": string
  "FACILITY NAME_34": string
  "FACILITY NAME_35": string
  "Enum_5": T4
  "Enum_6": T2
  "FACILITY NAME_36": string
  "DATE_5": timestamp
  "FACILITY NAME_37": string
  "FACILITY NAME_38": string
  "FACILITY NAME_39": string
  "FACILITY NAME_40": string
  "FACILITY NAME_41": string
  "FACILITY NAME_42": string
  "FACILITY NAME_43": string
  "FACILITY NAME_44": string
  "FACILITY NAME_45": string
  "FACILITY NAME_46": string
  "Enum_8": T4
  "Enum_9": T2
  "FACILITY NAME_47": string
  "FACILITY NAME_48": string
  "Timestamp_3": timestamp
  "FACILITY NAME_49": string
  "FACILITY NAME_50": string
  "FACILITY NAME_51": string
  "FACILITY NAME_52": string
  "FACILITY NAME_53": string
  "FACILITY NAME_54": string
  "FACILITY NAME_55": string
  "FACILITY NAME_56": string
  "Enum_10": T3
  "Enum_11": T2
  "FACILITY NAME_57": string
  "FACILITY NAME_58": string
  "FACILITY NAME_59": string
  "FACILITY NAME_60": string
  "FACILITY NAME_61": string
types:
  T1 = enum{"January", "February", "March", "April", "May", "June", "July", "August", "September", "October", "November", "December"}
  T2 = enum{"2020", "2021", "2022", "2023", "2024", "2025", "2026", "2027", "2028", "2029", "2030"}
  T3 = enum{"JANUARY", "FEBRUARY", "MARCH", "APRIL", "MAY", "JUNE", "JULY", "AUGUST", "SEPTEMBER", "OCTOBER", "NOVEMBER", "DECEMBER"}
  T4 = enum{"JANUARY", "FEBRUARY", "MARCH", "APRIL", "MAY", "JUNE", "JULY", "AUGUST", "SEPTEMBER", "OCTOBER", "NOVEMBER ", "DECEMBER"}
diagram:
  while {
    Wait(time to wait=100)
    case ($Button) {
      frame False, Default { }
      frame True {
        sequence {
          frame 0 {
            w1 = $USERNAME
            w2 = [["ALPTNAV", "ALPTNAV"], ["ADMIN", "ADMIN"], ["", ""], ["", ""], ["", ""], ["", ""], ["", ""]]
            Transpose 2D Array(2D array=w2) -> (transposed array=w3)
            Array Index(array=w3) -> (out0[0, _]=w4, out1[1, _]=w5)
            for {
              w6 = each element of w4
              Is Equal(x=w6, y=w1) -> w7
              stop if w7
            }
            Array Index(array=w5) -> (out0[_]=w8)
            Is Equal(x=w8, y=$PASSWORD) -> w9
            Logical And(w7, w9) -> w10
            case (w10) {
              frame False, Default {
                $Tab <- "Tab 0"
                w11 = "Login Failed!!!"
                w12 = FALSE
              }
              frame True {
                $Tab <- "Tab 1"
                w11 = "Successful Login!!!"
                w12 = TRUE
              }
            }
            $STATUS <- w11
            $LED <- w12
          }
          frame 1 { }
        }
      }
    }
    stop if FALSE
  }
  $PASSWORD <- ""
  $USERNAME <- ""
  $STATUS <- ""
  while {
    Wait(time to wait=100)
    event {
      on "old pp" Value changed {
        $Tab <- "Tab 12"
      }
      on "ERASE ALL" Value changed {
        $"AC AMMETER" <- ""
        $"AC VOLTMETER" <- ""
        $DATE <- 1904-01-01T00:00:00Z
        $"DC AMMETER CC1" <- ""
        $"DC AMMETER CC2" <- ""
        $"DC VOLTMETER CC1" <- ""
        $"FACILITY NAME" <- "NAVAIDS/RADAR POWER PLANT"
        $"DC VOLTMETER CC2" <- ""
        $YEAR <- "2020"
        $"WATTHOUR METER" <- ""
        $"FREQUENCY METER" <- ""
        $MONTH <- "August"
        $"SIGNATURE/INITIAL" <- ""
        $"POWER FACTOR" <- ""
        $"TIME(TMZ)" <- ""
      }
      on "tpr" Value changed {
        $Tab <- "Tab 3"
      }
      on "Button_6" Value changed {
        $Tab <- "Tab 4"
      }
      on "Button_2" Value changed {
        $"FACILITY NAME_4" <- ""
        $"FACILITY NAME_10" <- ""
        $"FACILITY NAME_11" <- ""
        $"FACILITY NAME_12" <- ""
        $DATE_2 <- 1904-01-01T00:00:00Z
        $"FACILITY NAME_13" <- ""
        $"FACILITY NAME_3" <- ""
        $Enum <- "JANUARY"
        $"FACILITY NAME_2" <- "NAVAIDS/RADAR POWER PLANT"
        $"FACILITY NAME_5" <- ""
        $"FACILITY NAME_6" <- ""
        $"FACILITY NAME_7" <- ""
        $"FACILITY NAME_8" <- ""
        $Enum_7 <- "2020"
        $"FACILITY NAME_9" <- ""
      }
      on "Button_5" Value changed {
        $"TIME (MTZ)" <- ""
        $"SIGNATURE/INITIAL_2" <- ""
        $REMARKS <- ""
        $"FACILITY NAME_7" <- ""
        $YEAR_2 <- "2020"
        $"FACILITY NAME_8" <- ""
        $"FACILITY NAME_5" <- ""
        $"CHECK THE FAN BELT" <- ""
        $MONTH_2 <- "JANUARY"
        $"CHECK THE FAN BELT_2" <- ""
        $"CHECK THE FAN BELT_3" <- ""
        $"FACILITY NAME" <- "NAVAIDS/RADAR POWER PLANT"
        $"FACILITY NAME_2" <- ""
        $"FACILITY NAME_4" <- ""
        $Timestamp <- 1904-01-01T00:00:00Z
      }
      on "Button_9" Value changed {
        $"FACILITY NAME_16" <- ""
        $"FACILITY NAME_15" <- ""
        $Enum_3 <- "JANUARY"
        $Enum_4 <- "2020"
        $"FACILITY NAME_17" <- ""
        $"FACILITY NAME_18" <- ""
        $Timestamp_2 <- 1904-01-01T00:00:00Z
        $"FACILITY NAME_19" <- ""
        $"FACILITY NAME_20" <- ""
        $"FACILITY NAME_14" <- "NAVAIDS/RADAR POWER PLANT"
        $"FACILITY NAME_21" <- ""
        $"FACILITY NAME_22" <- ""
      }
      on "Button_8" Value changed {
        $Tab <- "Tab 6"
      }
      on "Button_7" Value changed {
        $Tab <- "Tab 5"
      }
      on "HOME" Value changed {
        $Tab <- "Tab 2"
      }
      on "HOME1" Value changed {
        $Tab <- "Tab 2"
      }
      on "HOME2" Value changed {
        $Tab <- "Tab 2"
      }
      on "HOME3" Value changed {
        $Tab <- "Tab 2"
      }
      on "HOME4" Value changed {
        $Tab <- "Tab 12"
      }
      on "ERASE ALL_2" Value changed {
        $"DC VOLTMETER CC1_2" <- ""
        $"AC AMMETER _2" <- ""
        $Tab <- "Tab 7"
        $"AC VOLTMETER_2" <- ""
        $"DC AMMETER CC1_2" <- ""
        $"DC AMMETER CC2_2" <- ""
        $"DC VOLTMETER CC2_2" <- ""
        $DATE_3 <- 2020-08-30T04:40:48Z
        $MONTH_3 <- "January"
        $"TIME(TMZ)_2" <- ""
        $YEAR_3 <- "2020"
        $"POWER FACTOR_2" <- ""
        $"FACILITY NAME_23" <- "NAVAIDS/RADAR POWER PLANT"
        $"FREQUENCY METER_2" <- ""
        $"SIGNATURE/INITIAL_3" <- ""
        $"WATTHOUR METER_2" <- ""
      }
      on "Button_3" Value changed {
        $"FACILITY NAME_33" <- ""
        $"FACILITY NAME_32" <- ""
        $Tab <- "Tab 8"
        $"FACILITY NAME_25" <- ""
        $"FACILITY NAME_26" <- ""
        $"FACILITY NAME_27" <- ""
        $Enum_5 <- "JANUARY"
        $"FACILITY NAME_28" <- ""
        $Enum_6 <- "2020"
        $"FACILITY NAME_29" <- ""
        $DATE_4 <- 1904-01-01T00:00:00Z
        $"FACILITY NAME_30" <- ""
        $"FACILITY NAME_31" <- ""
        $"FACILITY NAME_34" <- ""
        $"FACILITY NAME_24" <- "NAVAIDS/RADAR POWER PLANT"
        $"FACILITY NAME_35" <- ""
      }
      on "Button_4" Value changed {
        $"FACILITY NAME_36" <- "NAVAIDS/RADAR POWER PLANT"
        $"FACILITY NAME_37" <- ""
        $Tab <- "Tab 9"
        $"FACILITY NAME_38" <- ""
        $"FACILITY NAME_39" <- ""
        $"FACILITY NAME_40" <- ""
        $Enum_8 <- "JANUARY"
        $"FACILITY NAME_41" <- ""
        $Enum_9 <- "2020"
        $"FACILITY NAME_42" <- ""
        $"FACILITY NAME_43" <- ""
        $DATE_5 <- 1904-01-01T00:00:00Z
        $"FACILITY NAME_44" <- ""
        $"FACILITY NAME_45" <- ""
        $"FACILITY NAME_46" <- ""
        $"FACILITY NAME_47" <- ""
      }
      on "Button_10" Value changed {
        $"FACILITY NAME_61" <- ""
        $"FACILITY NAME_49" <- ""
        $Tab <- "Tab 10"
        $Enum_10 <- "JANUARY"
        $"FACILITY NAME_50" <- ""
        $Enum_11 <- "2020"
        $"FACILITY NAME_51" <- ""
        $"FACILITY NAME_52" <- ""
        $"FACILITY NAME_53" <- ""
        $Timestamp_3 <- 1904-01-01T00:00:00Z
        $"FACILITY NAME_54" <- ""
        $"FACILITY NAME_55" <- ""
        $"FACILITY NAME_48" <- "NAVAIDS/RADAR POWER PLANT"
        $"FACILITY NAME_56" <- ""
        $"FACILITY NAME_57" <- ""
        $"FACILITY NAME_58" <- ""
        $"FACILITY NAME_59" <- ""
        $"FACILITY NAME_60" <- ""
      }
      on "new pp" Value changed {
        $Tab <- "Tab 13"
      }
      on "BACK10" Value changed {
        $Tab <- "Tab 11"
      }
      on "BACK7" Value changed {
        $Tab <- "Tab 11"
      }
      on "BACK8" Value changed {
        $Tab <- "Tab 11"
      }
      on "BACK9" Value changed {
        $Tab <- "Tab 11"
      }
      on "Button_14" Value changed {
        $Tab <- "Tab 13"
      }
      on "tpr_2" Value changed {
        $Tab <- "Tab 7"
      }
      on "Button_12" Value changed {
        $Tab <- "Tab 9"
      }
      on "Button_11" Value changed {
        $Tab <- "Tab 8"
      }
      on "Button_13" Value changed {
        $Tab <- "Tab 10"
      }
      on "tpr_3" Value changed {
        $Tab <- "Tab 2"
      }
      on "HOME4_2" Value changed {
        $Tab <- "Tab 1"
      }
      on "HOME4_3" Value changed {
        $Tab <- "Tab 1"
      }
      on "tpr_4" Value changed {
        $Tab <- "Tab 11"
      }
    }
    stop if FALSE
  }
